# Grasshopper definition A2.gh (Grasshopper 1.0.8)

rectangle = Rectangle(Plane=PlaneXY(0, 0, 0), XSize=Slider(0.19, range=0..20), YSize=Slider(0.5, range=0..20), Radius=0)  # -> Rectangle, Length
number_slider = Slider(6, range=0..10)
vector_xyz = VectorXYZ(XComponent=Slider(-0.089, range=-20..20), YComponent=Slider(1.281, range=-20..20), ZComponent=0)  # -> Vector, Length
move = Move(Geometry=rectangle.Rectangle, Motion=vector_xyz.Vector)  # -> Geometry, Transform
polygon = Polygon(Plane=PlaneXY(0, 0, 0), Radius=Slider(2, range=0..20), Segments=number_slider, FilletRadius=Slider(0, range=0..7))  # -> Polygon, Length
arrpolar = PolarArray(Geometry=move.Geometry, Plane=PlaneXY(0, 0, 0), Count=number_slider, Angle=6.283185307)  # -> Geometry, Transform
merge = Merge(Data1=polygon.Polygon, Data2=arrpolar.Geometry)
